# Grasshopper definition S5-graph-stripper-custom.gh (Grasshopper 1.0.8)
# plug-ins: MeshEdit Components, Human

panel = Panel("D:\Davis\UPC\07 Algorithms Technologies\AP\sassion03\MPDA25-Session05\graphs\graphs-05-stripper-custom.py")
number_slider = Slider(3, range=0..10)
graphs_05_stripper_custom = FilePath(panel)
mesh = Mesh(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)
quadmesh = Mesh(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)
enneper = Data(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)
trimesh = Mesh(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)
mplane = MeshPlane(
    Boundary={Plane=PlaneXY(0, 0, 0), Size=Domain2(u=-10..10, v=-10..10)},
    WidthCount=number_slider,
    HeightCount=number_slider)  # -> Mesh, Area
make_sure_is_the_right_path = Panel(graphs_05_stripper_custom)
input_mesh = Mesh(mesh)
file = ReadFile(File=graphs_05_stripper_custom, PerLineParse=False)
preview = CustomPreview(Geometry=input_mesh, Material=ColourSwatch(SwatchColor=RGBA(214, 214, 214, 124)))
demesh = DeconstructMesh(Mesh=input_mesh)  # -> Vertices, Faces, Colours, Normals
conmesh = ConstructMesh(Vertices=demesh.Vertices, Faces=graft(demesh.Faces))  # -> flatten(Mesh)
py3 = Python3Script(script=file, m=input_mesh, s=Slider(5, range=0..10))  # -> out, a, b, c; inputs m: Mesh, s: Int32; unedited script template
item = ListItem(List=conmesh, Index=py3.a, Wrap=True)
clean = CombineClean(Meshes=item)  # -> flatten(Mesh)
pline = PolyLine(Vertices=py3.b, Closed=False)  # -> flatten(Polyline)
data = Data(py3.a)
lng = ListLength(List=pline)
item_2 = ListItem(List=pline, Index=Slider(31, range=0..100), Wrap=True)
wheel = ColourWheel(
    lng,
    ColourGrips_Style=30,
    ColourGrips_Grip=[0, 2.094395102, 4.188790205, 3.141592654],
    ColourGrips_Lum=[0.1, 0.5],
    ColourGrips_Range=[0.2617993878, 0.2617993878, 0.2617993878, 0.2617993878],
    ColourGrips_Sat=[0.2, 0.6])
mesh_2 = Mesh(clean)
panel_2 = Panel(data)

py3_2 = Python3Script(N=Slider(1, range=0..1), meshes=mesh_2)  # -> out, max_mesh, max_area; inputs N: Int32, meshes: list of Mesh
# ---------- py3_2: Python ----------
import Rhino.Geometry as rg


def get_polyline_from_face_centers(mesh):
    """Construct a polyline through the face centers of the mesh."""
    centers = [mesh.Faces.GetFaceCenter(i) for i in range(mesh.Faces.Count)]
    return rg.Polyline(centers)

def compute_polyline_length(polyline):
    """Returns the total length of a polyline."""
    if polyline is None or len(polyline) < 2:
        return 0.0
    return polyline.Length

mesh_info = []  

for i, m in enumerate(meshes):
    if m is not None and m.IsValid and m.Faces.Count >= 2:
        polyline = get_polyline_from_face_centers(m)
        length = compute_polyline_length(polyline)
        mesh_info.append((i, m, length))


mesh_info.sort(key=lambda x: x[2])


mesh_info.reverse()

N = max(1, min(N, len(mesh_info)))
top = mesh_info[:N]

out_meshes = [m for _, m, _ in top]
out_lengths = [l for _, _, l in top]


max_mesh = top[-1][1] if top else None
max_area = top[-1][2] if top else None
# ---------- end py3_2 ----------
mesh_3 = Mesh(py3_2.max_mesh)

lng_2 = ListLength(List=mesh_2)
series = Series(Start=0, Step=1, Count=lng_2)
Z = UnitZ(Factor=series)
move = Move(Geometry=mesh_2, Motion=Z)  # -> Geometry, Transform
area = MeshArea(Mesh=move.Geometry)  # -> Area, Centroid
all_shortest_path = Data(move.Geometry)
sort = SortList(Keys=area.Area, ValuesA=all_shortest_path)  # -> Keys, ValuesA
item_3 = ListItem(List=reverse(sort.ValuesA), Index=0, Wrap=True)

lng_3 = ListLength(List=mesh_2)
series_2 = Series(Start=0, Step=1, Count=lng_3)
Z_2 = UnitZ(Factor=series_2)
move_2 = Move(Geometry=mesh_2, Motion=Z_2)  # -> Geometry, Transform
facen = FaceNormals(Mesh=move_2.Geometry)  # -> Centers, Normals
pline_2 = PolyLine(Vertices=facen.Centers, Closed=False)
explode = Explode(Curve=pline_2, Recursive=True)  # -> Segments, Vertices
shift = ShiftList(List=explode.Segments, Shift=1, Wrap=False)
all_shortest_path_2 = Data(move_2.Geometry)
angle = Angle(VectorA=explode.Segments, VectorB=shift)  # -> Angle, Reflex
ma = MassAddition(Input=angle.Angle)  # -> Result, PartialResults
sort_2 = SortList(Keys=flatten(ma.Result), ValuesA=all_shortest_path_2)  # -> Keys, ValuesA
item_4 = ListItem(List=reverse(sort_2.ValuesA), Index=0, Wrap=True)

py3_3 = Python3Script(N=Slider(1, range=0..1), meshes=mesh_2)  # -> out, max_mesh, max_area; inputs N: Int32, meshes: list of Mesh
# ---------- py3_3: Python ----------
import Rhino.Geometry as rg
import math


def angle_between(v1, v2):
    """Returns angle in radians between two vectors."""
    dot = v1 * v2
    mag = v1.Length * v2.Length
    if mag == 0:
        return 0.0
    return math.acos(max(min(dot / mag, 1.0), -1.0))

def get_polyline_from_face_centers(mesh):
    """Returns a polyline through mesh face centers."""
    return rg.Polyline([mesh.Faces.GetFaceCenter(i) for i in range(mesh.Faces.Count)])

def compute_angular_deviation(polyline):
    """Computes total angular deviation of a polyline's segments."""
    if polyline is None or len(polyline) < 3:
        return float('inf')

    vectors = []
    for i in range(len(polyline) - 1):
        vec = polyline[i + 1] - polyline[i]
        if vec.Length > 0:
            vec.Unitize()
            vectors.append(vec)

    
    total_angle = 0.0
    for i in range(len(vectors) - 1):
        angle = angle_between(vectors[i], vectors[i + 1])
        total_angle += angle

    return total_angle


mesh_info = []  
for i, m in enumerate(meshes):
    if m is not None and m.IsValid and m.Faces.Count >= 3:
        polyline = get_polyline_from_face_centers(m)
        deviation = compute_angular_deviation(polyline)
        mesh_info.append((i, m, deviation))


mesh_info.sort(key=lambda x: x[2])  


mesh_info.reverse()

N = max(1, min(N, len(mesh_info)))
top = mesh_info[:N]


out_meshes = [m for _, m, _ in top]
out_scores = [s for _, _, s in top]

max_mesh = top[-1][1] if top else None
max_area = top[-1][2] if top else None
# ---------- end py3_3 ----------
mesh_4 = Mesh(py3_3.max_mesh)

py3_4 = Python3Script(N=Slider(1, range=0..10), meshes=mesh_2)  # -> out, max_mesh, max_area; inputs N: Int32, meshes: list of Mesh
# ---------- py3_4: Python ----------
import Rhino.Geometry as rg


meshes = meshes  
N = N            


top_indices = []
top_meshes = []
top_areas = []

if meshes and N > 0:
  
    mesh_info = []

    for i, m in enumerate(meshes):
        if m is not None and m.IsValid:
            area = rg.AreaMassProperties.Compute(m).Area
            mesh_info.append((i, m, area))


    mesh_info.sort(key=lambda x: x[2], reverse=True)
    
    top = mesh_info[:min(N, len(mesh_info))]

    top_indices = [i for i, _, _ in top]
    top_meshes = [m for _, m, _ in top]
    top_areas = [a for _, _, a in top]
    
max_mesh = top_meshes[0] if top_meshes else None
max_area = top_areas[0] if top_areas else None
# ---------- end py3_4 ----------
mesh_5 = Mesh(py3_4.max_mesh)

panel_3 = Panel("Method I")

panel_4 = Panel("Method II")

previewlw = CustomPreviewLineweights(Geometry=pline, Shader=wheel, Thickness=Slider(2, range=0..10), Absolute=False)

lng_4 = ListLength(List=mesh_2)
series_3 = Series(Start=0, Step=1, Count=lng_4)
Z_3 = UnitZ(Factor=series_3)
move_3 = Move(Geometry=mesh_2, Motion=Z_3)  # -> Geometry, Transform
facen_2 = FaceNormals(Mesh=move_3.Geometry)  # -> Centers, Normals
pline_3 = PolyLine(Vertices=facen_2.Centers, Closed=False)
all_shortest_path_3 = Data(move_3.Geometry)

panel_5 = Panel("Method III")
len = Length(Curve=pline_3)

sort_3 = SortList(Keys=flatten(len), ValuesA=all_shortest_path_3)  # -> Keys, ValuesA
item_5 = ListItem(List=reverse(sort_3.ValuesA), Index=0, Wrap=True)
